# Grasshopper definition 13_GrasshopperWalker.gh (Grasshopper 0.9.76)
# plug-ins: Python Interpreter

python = PythonScript(a=Slider(0.364, range=0..1), b=Slider(0.125, range=0..1))  # -> out, c
# ---------- python: Python ----------
import rhinoscriptsyntax as rs
import random

if a>b:
    print "a is bigger!"
else:
    print "b is bigger!"

c = (b*a+100)/.05
# ---------- end python ----------
panel = Panel(python.c)
panel_2 = Panel(python.out)

int = Integer(Slider(200, range=1..200))
walker = PythonScript(seed=Slider(63, range=0..100), steps=int)  # -> out, pipe
# ---------- walker: Python ----------
import rhinoscriptsyntax as rs
import random

random.seed(seed)

class Walker:
    def __init__(self):
        self.x = 0 
        self.y = 0
        self.z = 0
        self.shape = 0
    def getLocation(self):
        return self.shape
    def step(self):
        stepX = random.uniform(-1,1)
        self.x += stepX
        stepY = random.uniform(-1,1)
        self.y += stepY
        stepZ = random.uniform(-1,1)
        self.z += stepZ
        self.shape = rs.AddPoint(self.x,self.y, self.z)
        return self.shape

w = Walker()

points = []
radii = []
parameters = []

pipe = 0

for i in range(steps):
    w.step()
    points.append(w.getLocation())

parameterCounter = 0.0
for point in points:
    tempRadius = random.uniform(.05,.25)
    radii.append(tempRadius)
    parameters.append(parameterCounter)
    parameterCounter += 1/len(points)

curve = rs.AddCurve(points)
pipe = rs.AddPipe(curve, parameters, radii, 1, 2, False)
# ---------- end walker ----------
walker_2 = PythonScript(seed=Slider(29, range=0..100))  # -> out, pipe
# ---------- walker_2: Python ----------
import rhinoscriptsyntax as rs
import random

random.seed(seed)

class Walker:
    def __init__(self):
        self.x = 0 
        self.y = 0
        self.z = 0
        self.shape = 0
    def getLocation(self):
        return self.shape
    def step(self):
        stepX = random.uniform(-1,1)
        self.x += stepX
        stepY = random.uniform(-1,1)
        self.y += stepY
        stepZ = random.uniform(-1,1)
        self.z += stepZ
        self.shape = rs.AddPoint(self.x,self.y, self.z)
        return self.shape

w = Walker()

points = []
radii = []
parameters = []

pipe = 0

for i in range(100):
    w.step()
    points.append(w.getLocation())

parameterCounter = 0.0
for point in points:
    tempRadius = random.uniform(.05,.25)
    radii.append(tempRadius)
    parameters.append(parameterCounter)
    parameterCounter += 1/len(points)

curve = rs.AddCurve(points)
pipe = rs.AddPipe(curve, parameters, radii, 1, 2, False)
# ---------- end walker_2 ----------
